# Grasshopper definition robot_control.gh (Grasshopper 1.0.7)
# plug-ins: VirtualRobot.Grasshopper

# ---- group: Robot Definition
pt = Point(<point referenced from the Rhino model>)
yz = YZPlane(Origin=pt)
rotate = Rotate(Geometry=yz, Angle=degrees("90"), Plane=yz)  # -> Geometry, Transform
brep = Brep(<brep referenced from the Rhino model>)
end_effector = DefineEndEffector(Geometry=brep, TCPFrame=rotate.Geometry, MountingFrame=PlaneXY(0, 0, 0))
kuka_kr_210 = PredefinedKUKAKR210Robot(RobRootFrame=PlaneXY(0, 0, 0), EndEffectorOptional=end_effector, variant="R2700")

# ---- group: Calibration Parameters
distance_domain = Panel("1500 to 3000")
angle_domain_deg = Panel("0 to 30")
target_surface = Curve(<curve referenced from the Rhino model>)
save = Button()
num_batches = Number("4")
range = Range(Domain=distance_domain, Steps=expr("x-1", num_batches))
num_shots = Number("5")
range_2 = Range(Domain=angle_domain_deg, Steps=expr("x-1", num_shots))
target = Rectangle(target_surface)
distances = Number(range)
angles = Number(range_2)

# ----
target_2 = Rectangle(target)
explode = Explode(Curve=target_2, Recursive=True)  # -> Segments, Vertices
item = ListItem(List=explode.Segments, Index=0, Wrap=True)  # -> Item, Item1, Item2
Z = UnitZ(Factor=Slider(1000, range=0..2000))
move = Move(Geometry=item.Item2, Motion=Z)  # -> Geometry, Transform
midpt = CurveMiddle(Curve=move.Geometry)
scale = Scale(Geometry=move.Geometry, Center=midpt, Factor=0.5)  # -> Geometry, Transform
num_batches_2 = Number(expr("x-1", num_batches))
target_3 = Rectangle(target)
divide = DivideCurve(Curve=scale.Geometry, Count=num_batches_2, Kinks=False)  # -> Points, Tangents, Parameters
boundary = BoundarySurfaces(Edges=target_3)
srf_cp = SurfaceClosestPoint(Point=divide.Points, Surface=boundary)  # -> Point, UVPoint, Distance
distances_2 = Number(distances)
evalsrf = EvaluateSurface(Surface=boundary, Point=srf_cp.UVPoint)  # -> Point, Normal, UDirection, VDirection, Frame
target_point = Point(evalsrf.Point)
amp = Amplitude(Vector=evalsrf.Normal, Amplitude=distances_2)
move_2 = Move(Geometry=target_point, Motion=amp)  # -> Geometry, Transform
yz_2 = YZPlane(Origin=move_2.Geometry)
pln = Plane(graft(yz_2))
deplane = DeconstructPlane(Plane=pln)  # -> Origin, XAxis, YAxis, ZAxis
pl = PlaneNormal(Origin=deplane.Origin, ZAxis=deplane.XAxis)
angles_2 = Number(angles)
rotate_2 = Rotate(Geometry=pln, Angle=expr("-x", degrees(angles_2)), Plane=pl)  # -> Geometry, Transform
target_point_2 = Point(target_point)
num_shots_2 = Number(num_shots)
rootdir = GhPythonScript()  # -> rootdir
# ---------- rootdir: Python ----------
rootdir = ghdoc.Path.rsplit("\\", 1)[0] + "\\"
# ---------- end rootdir ----------
pln_2 = Plane(flatten(rotate_2.Geometry))
merge = Merge(Data1=Toggle(False), Data2=Toggle(False), Data3=Toggle(False))
dup = DuplicateData(Data=graft(target_point_2), Number=num_shots_2, Order=True)  # -> simplify(flatten(Data))
gframe = GetFrame(Frame=simplify(flatten(rotate_2.Geometry)))  # -> XYZLocation, ABCOrientation
concat = Concatenate(FragmentA=rootdir, FragmentB="Targets\targets_00.json")
save_2 = Boolean(save)
robot_ik = RobotInverseKinematics(Robot=kuka_kr_210, TargetTCPFrame=pln_2, AxisToggles=merge, useColorPreview=True)  # -> PoseGeometry, AxisValues, AxisFrames
savetarget = GhPythonScript(XYZ=gframe.XYZLocation, ABC=gframe.ABCOrientation, Target=dup, filepath=concat, save=save_2)  # inputs XYZ: list of Point3d, ABC: list of Point3d, Target: list of Point3d
# ---------- savetarget: Python ----------
import json
import Rhino as rh

if save:

    json_dict = {"Targets":[]}

    for pos,d,t in zip(XYZ,ABC,Target):
        json_dict["Targets"].append({
            "pos_x" : pos.X,
            "pos_y" : pos.Y,
            "pos_z" : pos.Z,
            "pos_a" : d.X,
            "pos_b" : d.Y,
            "pos_c" : d.Z,
            "target_x" : t.X,
            "target_y" : t.Y,
            "target_z" : t.Z
            })
    
    with open(filepath, 'w') as file:
        file.write(json.dumps(json_dict, indent = 4))
# ---------- end savetarget ----------
mesh = Mesh(robot_ik.PoseGeometry)
